# Grasshopper definition Calculate.ghx (Grasshopper 1.0.7)
# plug-ins: FEM-Design, Tenrec

unit_x = UnitX(Factor=1)
point = Point(Point(0, 0, 0))
line_sdl = LineSDL(Start=point, Direction=unit_x, Length=Slider(10, range=0..10))

materialdatabase = MaterialDatabase(CountryCode="S")  # -> SteelMaterial, ConcreteMaterial, TimberMaterial, ReinforcementMaterial, StratumMaterial, CustomMaterial
sectiondatabase = SectionDatabase()  # -> SteelSection, ConcreteSection, TimberSection, HollowCoreSection, CustomSection
list_item = ListItem(List=materialdatabase.SteelMaterial, Index=0, Wrap=True)
list_item_2 = ListItem(List=sectiondatabase.SteelSection, Index=0, Wrap=True)
bars_beam = BarsBeam(Curve=line_sdl, Material=list_item, Section=list_item_2, OrientLCS=True, Identifier="B")

value_list = ValueList({"ordinary", "dead_load", "soil_dead_load", "shrinkage", "prestressing", "fire", "seis_sxp", "seis_sxm", "seis_syp", "seis_sym"}, selected="dead_load")
value_list_2 = ValueList({"ordinary", "dead_load", "soil_dead_load", "shrinkage", "prestressing", "fire", "seis_sxp", "seis_sxm", "seis_syp", "seis_sym"}, selected="ordinary")
loadcase_construct = LoadCaseConstruct(Name="loadcase1", Type=value_list, DurationClass="permanent")
loadcase_construct_2 = LoadCaseConstruct(Name="loadcase2", Type=value_list_2, DurationClass="permanent")
merge = Merge(Data1=loadcase_construct, Data2=loadcase_construct_2)

unit_z = UnitZ(Factor=Slider(200, range=0..1000))
curve_middle = CurveMiddle(Curve=line_sdl)
pointload_define = PointLoadDefine(Point=curve_middle, Force=unit_z, LoadCase=loadcase_construct_2, Type="Force")

value_list_3 = ValueList({"ultimate_ordinary", "ultimate_accidental", "ultimate_seismic", "serviceability_quasi_permanent", "serviceability_frequent", "serviceability_characteristic"}, selected="ultimate_ordinary")
panel = Panel("""1.35
1.5""")
loadcombination_construct = LoadCombinationConstruct(Name="loadcomb", Type=value_list_3, LoadCase=merge, Gamma=panel)

end_points = EndPoints(Curve=line_sdl)  # -> Start, End
pointsupport_hinged = PointSupportHinged(PointPlane=[end_points.Start, end_points.End], Identifier="S")

# ---- group: Tenrec / ModelConstruct
model_construct = ModelConstruct(
    CountryCode="S",
    StructureElements=flatten([bars_beam, pointsupport_hinged]),
    Loads=pointload_define,
    LoadCases=merge,
    LoadCombinations=loadcombination_construct)
c_script = CSharpScript(model=model_construct)  # -> out, assert, message
# ---------- c_script: C# ----------
    if(model == null)
    {
      assert = false;
      message = "Model is null!";
    }
    else
    {
      assert = true;
      message = null;
    }
# ---------- end c_script ----------
assert = Assert(Assert=c_script.assert, Message=c_script.message)

# ---- group: Tenrec / StabilityAnalysisDefine
stability_define = StabilityDefine(LoadCombination=loadcombination_construct, NumShapes=Slider(1, range=0..1), PositiveOnly=False, NumIterations=20)
analysis_define = AnalysisDefine(
    Stability=stability_define,
    CalcCase=Toggle(False),
    CalcComb=Toggle(False),
    CalcCstage=False,
    CalcImpf=False,
    CalcGmax=False,
    CalcStab=Toggle(True),
    CalcFreq=False,
    CalcSeis=False,
    CalcDesign=False,
    CalcFootfall=False,
    Elemfine=True,
    Diaphragm=False,
    PeakSmoothing=False)
boolean_toggle = BooleanToggle(True)
application_runcalculation = ApplicationRunCalculation(Model=model_construct, Analysis=analysis_define, RunNode=boolean_toggle)  # -> Model, FiniteElement, Results
c_script_2 = CSharpScript(model=application_runcalculation.Model, finElem=application_runcalculation.FiniteElement, runNode=boolean_toggle)  # -> out, Assert, message; inputs runNode: Boolean
# ---------- c_script_2: C# ----------
    bool assert = true;
    string textRunTrue = "LoadCase calculation. Model or FiniteElement is null!";
    string textRunFalse = "LoadCase calculation. Model or FiniteElement should be null!";

    if(model == null)
    {
      assert = false;
      message = textRunTrue;
    }
    else if(finElem == null)
    {
      assert = false;
      message = textRunTrue;
    }
    if(!runNode)
    {
      assert = !assert;
      message = textRunFalse;
    }

    if(assert) message = null;
    Assert = assert;
# ---------- end c_script_2 ----------
c_script_3 = CSharpScript(analysis=analysis_define)  # -> out, assert, message
# ---------- c_script_3: C# ----------
    if(analysis == null)
    {
      assert = false;
      message = "LoadCase calculation. Analysis.Define is null!";
    }
    else
    {
      assert = true;
      message = null;
    }
# ---------- end c_script_3 ----------
assert_2 = Assert(Assert=c_script_3.assert, Message=c_script_3.message)
assert_3 = Assert(Assert=c_script_2.Assert, Message=c_script_2.message)

# ---- group: Tenrec / EigenFrequencyAnalysisDefine
freq_define = FreqDefine(NumShapes=2, MaxSturm=0, X=True, Y=True, Z=True, Top=-0.01)
analysis_define_2 = AnalysisDefine(
    Freq=freq_define,
    CalcCase=Toggle(False),
    CalcComb=Toggle(False),
    CalcCstage=False,
    CalcImpf=False,
    CalcGmax=False,
    CalcStab=Toggle(True),
    CalcFreq=False,
    CalcSeis=False,
    CalcDesign=False,
    CalcFootfall=False,
    Elemfine=True,
    Diaphragm=False,
    PeakSmoothing=False)
boolean_toggle_2 = BooleanToggle(True)
application_runcalculation_2 = ApplicationRunCalculation(Model=model_construct, Analysis=analysis_define_2, RunNode=boolean_toggle_2)  # -> Model, FiniteElement, Results
c_script_4 = CSharpScript(model=application_runcalculation_2.Model, finElem=application_runcalculation_2.FiniteElement, runNode=boolean_toggle_2)  # -> out, Assert, message; inputs runNode: Boolean; same code as c_script_2
c_script_5 = CSharpScript(analysis=analysis_define_2)  # -> out, assert, message; same code as c_script_3
assert_4 = Assert(Assert=c_script_5.assert, Message=c_script_5.message)
assert_5 = Assert(Assert=c_script_4.Assert, Message=c_script_4.message)

# ---- group: Tenrec / LoadCaseAnalysisDefine
analysis_define_3 = AnalysisDefine(
    CalcCase=Toggle(True),
    CalcComb=Toggle(False),
    CalcCstage=False,
    CalcImpf=False,
    CalcGmax=False,
    CalcStab=False,
    CalcFreq=False,
    CalcSeis=False,
    CalcDesign=False,
    CalcFootfall=False,
    Elemfine=True,
    Diaphragm=False,
    PeakSmoothing=False)
boolean_toggle_3 = BooleanToggle(True)
application_runcalculation_3 = ApplicationRunCalculation(Model=model_construct, Analysis=analysis_define_3, RunNode=boolean_toggle_3)  # -> Model, FiniteElement, Results
c_script_6 = CSharpScript(model=application_runcalculation_3.Model, finElem=application_runcalculation_3.FiniteElement, runNode=boolean_toggle_3)  # -> out, Assert, message; inputs runNode: Boolean; same code as c_script_2
c_script_7 = CSharpScript(analysis=analysis_define_3)  # -> out, assert, message; same code as c_script_3
assert_6 = Assert(Assert=c_script_7.assert, Message=c_script_7.message)
assert_7 = Assert(Assert=c_script_6.Assert, Message=c_script_6.message)

# ---- group: Tenrec / LoadCombAnalysisDefine
analysis_define_4 = AnalysisDefine(
    CalcCase=Toggle(False),
    CalcComb=Toggle(True),
    CalcCstage=False,
    CalcImpf=False,
    CalcGmax=False,
    CalcStab=False,
    CalcFreq=False,
    CalcSeis=False,
    CalcDesign=False,
    CalcFootfall=False,
    Elemfine=True,
    Diaphragm=False,
    PeakSmoothing=False)
boolean_toggle_4 = BooleanToggle(True)
application_runcalculation_4 = ApplicationRunCalculation(Model=model_construct, Analysis=analysis_define_4, RunNode=boolean_toggle_4)  # -> Model, FiniteElement, Results
c_script_8 = CSharpScript(model=application_runcalculation_4.Model, finElem=application_runcalculation_4.FiniteElement, runNode=boolean_toggle_4)  # -> out, Assert, message; inputs runNode: Boolean; same code as c_script_2
c_script_9 = CSharpScript(analysis=analysis_define_4)  # -> out, assert, message; same code as c_script_3
assert_8 = Assert(Assert=c_script_9.assert, Message=c_script_9.message)
assert_9 = Assert(Assert=c_script_8.Assert, Message=c_script_8.message)
