# Grasshopper definition RunAnalysis.gh (Grasshopper 1.0.7)
# plug-ins: FEM-Design, Tenrec

# ---- group: Tenrec / RunLoadCase
pt = Point(Point(0, 0, 0))
default = MaterialDatabaseDefault(CountryCode="S")  # -> SteelMaterial, ConcreteMaterial, TimberMaterial, ReinforcementMaterial, StratumMaterial, CustomMaterial
default_2 = SectionDatabaseDefault()  # -> SteelSection, ConcreteSection, TimberSection, HollowCoreSection, CustomSection
X = UnitX(Factor=1)
item = ListItem(List=default.SteelMaterial, Index=0, Wrap=True)
item_2 = ListItem(List=default_2.SteelSection, Index=0, Wrap=True)
line = LineSDL(Start=pt, Direction=X, Length="6.0")
list = ValueList({"ordinary", "dead_load", "soil_dead_load", "shrinkage", "prestressing", "fire", "seis_sxp", "seis_sxm", "seis_syp", "seis_sym"}, selected="dead_load")
rigid = PointSupportRigid(PointPlane=pt, Identifier="S")
construct = LoadCaseConstruct(Name="DL", Type=list, DurationClass="permanent")
beam = BarsBeam(Curve=line, Material=item, Section=item_2, OrientLCS=True, Identifier="B")
construct_2 = ModelConstruct(CountryCode="S", StructureElements=flatten([rigid, beam]), LoadCases=construct)
resultstype = ResultsType({"NodalDisplacement", "NodalDisplacement", "PointSupportReaction", "PointSupportReactionMinMax", "PointConnectionForce", "BarDisplacement", "BarInternalForce", "BarStress", "LineSupportReaction", "LineConnectionResultant"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}, selected="PointSupportReaction")
analysis = AnalysisDefine(
    CalcCase=Toggle(True),
    CalcCstage=False,
    CalcImpf=False,
    CalcComb=Toggle(False),
    CalcGmax=False,
    CalcStab=False,
    CalcFreq=False,
    CalcSeis=False,
    CalcDesign=False,
    CalcFootfall=False,
    Elemfine=True,
    Diaphragm=False,
    PeakSmoothing=False)
runcalculation = ApplicationRunCalculation(Model=construct_2, Analysis=analysis, ResultTypes=resultstype, RunNode=Toggle(True))  # -> Model, FiniteElement, Results
item_3 = ListItem(List=runcalculation.Results, Index=0, Wrap=True)
lng = ListLength(List=runcalculation.Results)
null = NullItem(Item=runcalculation.Model)  # -> NullFlags, InvalidFlags, Description
null_2 = NullItem(Item=item_3)  # -> NullFlags, InvalidFlags, Description
equals = Equality(FirstNumber=lng, SecondNumber="1")  # -> Equality, Inequality
bool = Boolean(invert(null.NullFlags))
bool_2 = Boolean(invert(null_2.NullFlags))
assert = Assert(Assert=bool, Message="Model is null!")
assert_2 = Assert(Assert=equals.Equality, Message="List length != 1")
assert_3 = Assert(Assert=bool_2, Message="Calculation Error!")
