# Grasshopper definition Model.ghx (Grasshopper 1.0.7)
# plug-ins: FEM-Design, Tenrec

# ---- group: ReadModelFromFile
c_script = CSharpScript()  # -> out, A
# ---------- c_script: C# ----------
    //var doc = Grasshopper.Instances.ActiveCanvas.Document;
    //A = System.IO.Path.GetDirectoryName(doc.FilePath);

    A = System.IO.Path.GetDirectoryName(GrasshopperDocument.FilePath);
# ---------- end c_script ----------
concatenate = Concatenate(FragmentA=c_script.A, FragmentB="\ReadModelTest.struxml")
model_readfromfile = ModelReadFromFile(FilePath=concatenate)
null_item = NullItem(Item=model_readfromfile)  # -> NullFlags, InvalidFlags, Description
boolean = Boolean(invert(null_item.NullFlags))
assert = Assert(Assert=boolean, Message="Read model from file failed!")

# ----
c_script_2 = CSharpScript()  # -> out, A
# ---------- c_script_2: C# ----------
    var doc = Grasshopper.Instances.ActiveCanvas.Document;
    A = System.IO.Path.GetDirectoryName(doc.FilePath);
# ---------- end c_script_2 ----------

# ---- group: Tenrec / ModelSerialize
panel = Panel("\ReadModelTest.struxml")
concatenate_2 = Concatenate(FragmentA=c_script_2.A, FragmentB="\ReadModelSerialized.struxml")

# ----
concatenate_3 = Concatenate(FragmentA=c_script_2.A, FragmentB=panel)

# ---- group: Tenrec / ModelSerialize (continued)
file_path = FilePath(concatenate_3)
model_readfromfile_2 = ModelReadFromFile(FilePath=file_path)
model_serialise = ModelSerialise(Model=model_readfromfile_2, FilePathStruxml=concatenate_2)
assert_2 = Assert(Assert=model_serialise, Message="Model.Serialise fail!")
